# Grasshopper definition delta error.gh (Grasshopper 0.9.72)

side_length = Slider(170, range=0..1000)
side_length_2 = Slider(170, range=0..1000)
twist_angle = Slider(0, range=0..10)
height = Slider(420, range=0..1000)
pt = ConstructPoint(XCoordinate=0, YCoordinate=0, ZCoordinate=0)
X = UnitX(Factor=side_length_2)
line = LineSDL(Start=pt, Direction=X, Length=side_length_2)
end = EndPoints(Curve=line)  # -> Start, End
cir = Circle(Plane=end.End, Radius=side_length_2)
cir_2 = Circle(Plane=end.Start, Radius=side_length_2)
ccx = CurveCurve(CurveA=cir, CurveB=cir_2)  # -> Points, ParamsA, ParamsB
number_slider = Slider(10, range=0..100)
number_slider_2 = Slider(1, range=0..1)
cull = CullPattern(List=ccx.Points, CullPattern=invert([False, True]))
weave = Weave(Pattern=[0, 1, 2], Stream0=end.Start, Stream1=cull, Stream2=end.End, NullGaps=False)
pline = PolyLine(Vertices=weave, Closed=True)
explode = Explode(Curve=pline, Recursive=True)  # -> Segments, Vertices
ln = Line(StartPoint=cull, EndPoint=end.Start)
ln_2 = Line(StartPoint=cull, EndPoint=end.End)
end_2 = EndPoints(Curve=explode.Segments)  # -> Start, End
linedim = LineDimension(Line=explode.Segments, Text="{0:0.00}", Size=number_slider)
Z = UnitZ(Factor=height)
move = Move(Geometry=pline, Motion=Z)  # -> Geometry, Transform
pcen = PolygonCenter(Polyline=move.Geometry)  # -> CenterV, CenterE, CenterA
rad = Radians(Degrees=twist_angle)
rotate = Rotate(Geometry=move.Geometry, Angle=rad, Plane=pcen.CenterV)  # -> Geometry, Transform
explode_2 = Explode(Curve=rotate.Geometry, Recursive=True)  # -> Segments, Vertices
end_3 = EndPoints(Curve=explode_2.Segments)  # -> Start, End
ln_3 = Line(StartPoint=end_2.Start, EndPoint=end_3.Start)
ln_4 = Line(StartPoint=end_2.End, EndPoint=end_3.Start)
len = Length(Curve=ln_4)
ln_5 = Line(StartPoint=end_2.Start, EndPoint=end_3.End)
panel = Panel(len)
linedim_2 = LineDimension(Line=ln_4, Text="{0:0.00}", Size=number_slider)
linedim_3 = LineDimension(Line=ln_5, Text="{0:0.00}", Size=number_slider)
len_2 = Length(Curve=ln_5)
subtraction = Subtraction(A=len, B=len_2)
markdim = MarkerDimension(Line=ln_3, Text=subtraction, Size=number_slider)
